# Grasshopper definition topoSpeckle.ghx (Grasshopper 1.0.7)
# plug-ins: Speckle 2

rendermaterial = RenderMaterial(
    Opacity="1",
    Metalness="0",
    Roughness="1",
    Diffuse=ColourSwatch(SwatchColor=RGB(122, 122, 122)),
    SelectedConstructorName="Objects.Other.RenderMaterial.ctor(System.Double,System.Double,System.Double,System.Nullable`1[System.Drawing.Color],System.Nullable`1[System.Drawing.Color])",
    SelectedTypeName="Objects.Other.RenderMaterial",
    UseSchemaTag=False,
    UserSetSchemaTag=False,
    seed="f71487c8e5fce9c67d16")
rendermaterial_2 = RenderMaterial(
    Opacity="1",
    Metalness="0",
    Roughness="1",
    Diffuse=ColourSwatch(SwatchColor=RGB(122, 122, 122)),
    SelectedConstructorName="Objects.Other.RenderMaterial.ctor(System.Double,System.Double,System.Double,System.Nullable`1[System.Drawing.Color],System.Nullable`1[System.Drawing.Color])",
    SelectedTypeName="Objects.Other.RenderMaterial",
    UseSchemaTag=False,
    UserSetSchemaTag=False,
    seed="203aa48e2cb00c0caa01")
rendermaterial_3 = RenderMaterial(
    Opacity="1",
    Metalness="0",
    Roughness="1",
    Diffuse=ColourSwatch(SwatchColor=RGB(201, 201, 201)),
    SelectedConstructorName="Objects.Other.RenderMaterial.ctor(System.Double,System.Double,System.Double,System.Nullable`1[System.Drawing.Color],System.Nullable`1[System.Drawing.Color])",
    SelectedTypeName="Objects.Other.RenderMaterial",
    UseSchemaTag=False,
    UserSetSchemaTag=False,
    seed="a733d1989930408f1873")
rendermaterial_4 = RenderMaterial(
    Opacity="1",
    Metalness="0",
    Roughness="1",
    Diffuse=ColourSwatch(SwatchColor=RGB(189, 189, 189)),
    SelectedConstructorName="Objects.Other.RenderMaterial.ctor(System.Double,System.Double,System.Double,System.Nullable`1[System.Drawing.Color],System.Nullable`1[System.Drawing.Color])",
    SelectedTypeName="Objects.Other.RenderMaterial",
    UseSchemaTag=False,
    UserSetSchemaTag=False,
    seed="c65aab5024e53213a342")
rendermaterial_5 = RenderMaterial(
    Opacity="1",
    Metalness="0",
    Roughness="1",
    Diffuse=ColourSwatch(SwatchColor=RGB(178, 178, 178)),
    SelectedConstructorName="Objects.Other.RenderMaterial.ctor(System.Double,System.Double,System.Double,System.Nullable`1[System.Drawing.Color],System.Nullable`1[System.Drawing.Color])",
    SelectedTypeName="Objects.Other.RenderMaterial",
    UseSchemaTag=False,
    UserSetSchemaTag=False,
    seed="e2656b01266e4fc7e95d")
python = GhPythonScript()  # -> out
# ---------- python: Python ----------
__author__ = "RivinduB"
__version__ = "2023.08.03"

import rhinoscriptsyntax as rs
import Rhino

my_doc = Rhino.RhinoDoc.CreateHeadless(None)
my_doc.ModelUnitSystem = Rhino.UnitSystem.Meters
Rhino.RhinoDoc.ActiveDoc = my_doc
# ---------- end python ----------
mesh = GetGeometry(AtLeast=1, AtMost=2147483647, DeleteInput=False, Filter=1074004029, TreeAccess=True)
buildings = GetGeometry(AtLeast=1, AtMost=2147483647, DeleteInput=False, Filter=1074004029, TreeAccess=True)
elevatedbuildings = GetGeometry(AtLeast=1, AtMost=2147483647, DeleteInput=False, Filter=1074004029, TreeAccess=True)
roads = GetGeometry(AtLeast=1, AtMost=2147483647, DeleteInput=False, Filter=1074004029, TreeAccess=True)
contours = GetGeometry(AtLeast=1, AtMost=2147483647, DeleteInput=False, Filter=1074004029, TreeAccess=True)
lots = GetGeometry(AtLeast=1, AtMost=2147483647, DeleteInput=False, Filter=1074004029, TreeAccess=True)
streamid = GetString(AtLeast=1, AtMost=2147483647, TreeAccess=True)
demesh = DeconstructMesh(Mesh=flatten(mesh))  # -> flatten(Vertices), Faces, Colours, Normals
modelcurve = ModelCurve(
    BaseCurve=contours,
    LineStyle="DDG_Contours",
    SelectedConstructorName="Objects.BuiltElements.Revit.Curve.ModelCurve.ctor(Objects.ICurve,System.String,System.Collections.Generic.List`1[Objects.BuiltElements.Revit.Parameter])",
    SelectedTypeName="Objects.BuiltElements.Revit.Curve.ModelCurve",
    UseSchemaTag=False,
    UserSetSchemaTag=False,
    seed="ed219971c30e3abf0826")
modelcurve_2 = ModelCurve(
    BaseCurve=roads,
    LineStyle="DDG_Roads",
    SelectedConstructorName="Objects.BuiltElements.Revit.Curve.ModelCurve.ctor(Objects.ICurve,System.String,System.Collections.Generic.List`1[Objects.BuiltElements.Revit.Parameter])",
    SelectedTypeName="Objects.BuiltElements.Revit.Curve.ModelCurve",
    UseSchemaTag=False,
    UserSetSchemaTag=False,
    seed="cae901f2f954885ff7ee")
modelcurve_3 = ModelCurve(
    BaseCurve=lots,
    LineStyle="DDG_Lots",
    SelectedConstructorName="Objects.BuiltElements.Revit.Curve.ModelCurve.ctor(Objects.ICurve,System.String,System.Collections.Generic.List`1[Objects.BuiltElements.Revit.Parameter])",
    SelectedTypeName="Objects.BuiltElements.Revit.Curve.ModelCurve",
    UseSchemaTag=False,
    UserSetSchemaTag=False,
    seed="3dbc0a5319c336bb4c13")
to_speckle = ToSpeckle(Data=flatten(elevatedbuildings), preprocessGeometry=False, selectedKitName="Objects")
to_speckle_2 = ToSpeckle(Data=flatten(buildings), preprocessGeometry=False, selectedKitName="Objects")
accst = AccountFromServerToken(Server="https://speckle.xyz/", AuthToken="091eabd976672b05e476e09b315f8bc1a254de4ca0")
patch = Patch(Points=demesh.Vertices, Spans=20, Flexibility=1, Trim=True)
sget = StreamGet(StreamIDURL=flatten(streamid), SpeckleAccount=accst)
eso = ExtendSpeckleObject(SpeckleObject=to_speckle_2, RenderMaterial=rendermaterial, selectedKitName="Objects")
eso_2 = ExtendSpeckleObject(SpeckleObject=to_speckle, RenderMaterial=rendermaterial_2, selectedKitName="Objects")
revittopography = RevitTopography(
    DisplayMesh=patch,
    SelectedConstructorName="Objects.BuiltElements.Revit.RevitTopography.ctor(Objects.Geometry.Mesh,System.Collections.Generic.List`1[Objects.BuiltElements.Revit.Parameter])",
    SelectedTypeName="Objects.BuiltElements.Revit.RevitTopography",
    UseSchemaTag=False,
    UserSetSchemaTag=False,
    seed="1a35f28e0ab8cd1c6664")
to_speckle_3 = ToSpeckle(Data=flatten(modelcurve), preprocessGeometry=False, selectedKitName="Objects")
to_speckle_4 = ToSpeckle(Data=flatten(modelcurve_2), preprocessGeometry=False, selectedKitName="Objects")
to_speckle_5 = ToSpeckle(Data=flatten(modelcurve_3), preprocessGeometry=False, selectedKitName="Objects")
eso_3 = ExtendSpeckleObject(SpeckleObject=to_speckle_3, RenderMaterial=rendermaterial_3, selectedKitName="Objects")
eso_4 = ExtendSpeckleObject(SpeckleObject=to_speckle_4, RenderMaterial=rendermaterial_4, selectedKitName="Objects")
eso_5 = ExtendSpeckleObject(SpeckleObject=to_speckle_5, RenderMaterial=rendermaterial_5, selectedKitName="Objects")
to_speckle_6 = ToSpeckle(Data=flatten(revittopography), preprocessGeometry=False, selectedKitName="Objects")
ss = SynchronousSender(
    Data=to_speckle_6,
    Stream=sget,
    Message="Topography for Revit",
    OutputWrappers="https://speckle.xyz\t6928d0bb9a\t165eb6dcd1",
    UseDefaultCache=True,
    selectedKitName="Objects")
ss_2 = SynchronousSender(
    Data=eso,
    Stream=sget,
    Message="Buildings for Revit",
    OutputWrappers="https://speckle.xyz\t833c312f80\t0616e71eb6",
    UseDefaultCache=True,
    selectedKitName="Objects")
ss_3 = SynchronousSender(
    Data=eso_2,
    Stream=sget,
    Message="Buildings Elevated for Revit",
    OutputWrappers="https://speckle.xyz\t833c312f80\t5f80331418",
    UseDefaultCache=True,
    selectedKitName="Objects")
ss_4 = SynchronousSender(
    Data=eso_3,
    Stream=sget,
    Message="Contours for Revit",
    OutputWrappers="https://speckle.xyz\t833c312f80\td4c20c6f95",
    UseDefaultCache=True,
    selectedKitName="Objects")
ss_5 = SynchronousSender(
    Data=eso_4,
    Stream=sget,
    Message="Roads for Revit",
    OutputWrappers="https://speckle.xyz\t833c312f80\td4c20c6f95",
    UseDefaultCache=True,
    selectedKitName="Objects")
ss_6 = SynchronousSender(
    Data=eso_5,
    Stream=sget,
    Message="Lots for Revit",
    OutputWrappers="https://speckle.xyz\t833c312f80\td4c20c6f95",
    UseDefaultCache=True,
    selectedKitName="Objects")

# ---- group: RH_OUT:Stream
txt = Text(ss)
